% Simulink data dictionary BatteryDCDC.sldd

PlntDCDCEff = 98
PlntDCDCVoltInit = 650
PlntBattIdealVolt = 400
PlntBattIdealSoc = 80

Contact = enum(DefaultValue="Open", StorageType="int8")
  Init = 0
  Open = 1
  Close = 2

PlntBattTempInitDegC = 25
PlntBattCntctrClsdRes = 0.0001
PlntBattCntctrOpenCond = 1.0e-8
PlntBattCntctrThresh = 0.9
PlntBattPreChrgRes = 20
PlntBattPreChrgCap = 10000
PlntBattPreChrgCapSerRes = 1.0e-9
PlntBattPreChrgCapParCond = 0
PlntBattBleedRes = 20
PlntBattBalSwtchClsdRes = 0.01
PlntBattBalSwtchOpenCond = 1.0e-8
PlntBattBalSwtchThresh = 0
PlntBattCondArea = 0.0037
PlntBattCondThick = 0.001
PlntBattThermCond = 205
PlntDCDCEffCurrVec = [-500 -1 1 500]
PlntDCDCEffTmpVec = [280 300 320]
PlntDCDCInitTemp = 300
PlntDCDCMaxCurr = 500
PlntDCDCOutVoltDroop = 0.1
PlntDCDCZeroOutPwrLoss = 1
PlntDCDCFltrCap = 100
PlntDCDCFltrRes = 1.0e-6
PlntDCDCLossV = [0 200 400 600 800 1000]
PlntDCDCTimeCnst = 0.005
PlntBattCp = 900
PlntBattCpBpt = [273 373]
PlntBattCapInit = 2.88
Sig = Simulink.Signal()
PlntDCDCMass = 10
PlntBattCapInitAh = Simulink.Parameter(Simulink.data.Expression(ExpressionString="PlntBattSocInit*PlntBattChrgMax"))
PlntBattOpenCircVTotal = Simulink.Parameter(Simulink.data.Expression(ExpressionString="PlntBattOpenCirctVolt*PlntBattNumCellSer"))
PlntBattOperRange = Simulink.Parameter(Simulink.data.Expression(ExpressionString="[2.25 Inf]*PlntBattNumCellSer"))
PlntBattTermRes = Simulink.Parameter(Simulink.data.Expression(ExpressionString="PlntBattIntrnRes*(PlntBattNumCellSer/PlntBattNumCellPar)"))
PlntBattCellCap = Simulink.Parameter(Simulink.data.Expression(ExpressionString="PlntBattChrgMax*PlntBattNumCellPar"))
PlntBattThMass = Simulink.Parameter(Simulink.data.Expression(ExpressionString="PlntBattMass*PlntBattCp"))
PlntBattMass = Simulink.Parameter(Simulink.data.Expression(ExpressionString="PlntCellMassEv*PlntBattNumCellSer*PlntBattNumCellPar"))

PlntBattOpenCircVTbl = Simulink.Parameter(Simulink.data.Expression(
  ExpressionString="interp2(PlntBattTempBpt,PlntBattVoltSocBpt',PlntBattOpenCirctVolt,PlntBattTempInitDegC+273.15,PlntBattVoltSocBpt')'"))

PlntBattDCDCVinit = Simulink.Parameter(Simulink.data.Expression(
  ExpressionString="interp2(PlntBattTempBpt,PlntBattVoltSocBpt,PlntBattOpenCirctVolt*PlntBattNumCellSer,PlntBattTempInitDegC+273.15,PlntBattSocInit)"))

PlntDCDCLossTbl = [0 0 0 0 0 0 0 0
 0 100 200 300 400 500 600 700
 0 200 400 600 800 1000 1200 1400
 0 300 600 900 1200 1500 1800 2100
 0 400 800 1200 1600 2000 2400 2800
 0 500 1000 1500 2000 2500 3000 3500]

PlntDCDCLossI = [0 25 50 75 100 125 150 175]
PlntBattNumCellSer = 96
PlntBattNumCellPar = 46
PlntBattChrgMax = 4.85
PlntBattTimeCnst = 0.001

PlntBattOpenCirctVolt = [3.17242 3.17242 3.17242 3.17242 3.17242 3.17242 3.17242
 3.18272 3.18272 3.18272 3.18272 3.18272 3.18272 3.18272
 3.19302 3.19302 3.19302 3.19302 3.19302 3.19302 3.19302
 3.20331 3.20331 3.20331 3.20331 3.20331 3.20331 3.20331
 3.21361 3.21361 3.21361 3.21361 3.21361 3.21361 3.21361
 3.22391 3.22391 3.22391 3.22391 3.22391 3.22391 3.22391
 3.23421 3.23421 3.23421 3.23421 3.23421 3.23421 3.23421
 3.24451 3.24451 3.24451 3.24451 3.24451 3.24451 3.24451
 3.25481 3.25481 3.25481 3.25481 3.25481 3.25481 3.25481
 3.2651 3.2651 3.2651 3.2651 3.2651 3.2651 3.2651
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 ]

PlntBattVoltSocBpt = [0 0.01 0.02 0.03 0.04 0.05 0.06 0.07 0.08 0.09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 1]
PlntBattTempBpt = [233.15 243.15 253.15 273.15 296.15 318.15 333.15]

PlntBattIntrnRes = [0.3026 0.35142 0.34349 0.24415 0.02095 0.15874 0.14729
 0.2941 0.33555 0.32379 0.22614 0.01921 0.13363 0.12249
 0.28559 0.31969 0.30408 0.20813 0.01774 0.10853 0.10276
 0.27709 0.30382 0.28438 0.19012 0.0166 0.09423 0.0861
 0.26858 0.28796 0.26468 0.17211 0.01557 0.07998 0.0748
 0.26008 0.27209 0.24498 0.1541 0.01469 0.07024 0.06679
 0.25157 0.25623 0.22527 0.1361 0.01398 0.06387 0.05877
 0.24307 0.24036 0.20557 0.11861 0.01338 0.0575 0.05275
 0.23456 0.2245 0.18587 0.10674 0.01283 0.05113 0.04899
 0.22606 0.20863 0.16617 0.09525 0.01239 0.04679 0.04522
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 ]

PlntBattSocBpt = [0 0.01 0.02 0.03 0.04 0.05 0.06 0.07 0.08 0.09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 1]
PlntBattSocInit = 0.6
PlntCellMassEv = 0.069
PlntDCDCPwrLmt = 242650