% Simulink data dictionary HevMmVCU.sldd

CtrlVcuHevMmChrgSOCHi = 80
CtrlVcuHevMmChrgSOCLo = 70
CtrlVcuHevMmEngCltchOffTractiveForce = 3000
CtrlVcuHevMmEngCltchOffVehSpd = 70
CtrlVcuHevMmEngCltchOnTractiveForce = 2000
CtrlVcuHevMmEngCltchOnVehSpd = 80
CtrlVcuHevMmEngCltchOnWait = 5
CtrlVcuHevMmFricBrakeCmd = [0 0 12 24 36 48 60]
CtrlVcuHevMmFricBrakeCmdBpt = [0 0.1 0.2 0.4 0.6 0.8 1]
CtrlVcuHevMmMaxChrgPwr = 50000
CtrlVcuHevMmMaxRegenPwr = 10000
CtrlVcuHevMmTs = 0.01

CtrlVcuHevMmeng = struct(
  pwr=[15052.63 19736.84 24421.05 29105.26 33789.47 38473.68 43157.89 47842.11 52526.32 57210.53 61894.74 66578.95 71263.16 75947.37 80631.58 85315.79 90000],
  spd=[1448.849 1712.991 1980.336 2249.116 2517.56 2783.899 3046.364 3303.185 3552.592 3792.817 4022.089 4238.64 4440.699 4626.498 4794.266 4942.234 5068.633],
  bsfc=[256.7432 250.9881 246.1629 242.2918 239.3989 237.5081 236.6435 236.8292 238.0893 240.4478 243.9288 248.5563 254.3544 261.3472 269.5586 279.0129 289.734],
  trq=[99.21122 110.0257 117.7598 123.5751 128.1661 131.972 135.2851 138.3085 141.1897 144.0408 146.9513 149.9967 153.2446 156.7587 160.6033 164.8457 169.5599],
  idle=1448.849,
  ff=[0.001073517 0.001376031 0.001669877 0.00195888 0.002246989 0.002538281 0.002836954 0.003147336 0.003473877 0.003821152 0.004193864 0.004596838 0.005035028 0.005513508 0.006037483 0.006612279 0.007243349],
  pwrin=[46556.89 59676.49 72420.18 84953.81 97448.7 110081.6 123034.6 136495.4 150657 165717.9 181881.8 199358.3 218361.9 239112.9 261837 286765 314133.6])

CtrlVcuHevMmgen = struct(
  max_trq=247.5806,
  max_pwr=102.1018,
  spd=[0 500 1000 1500 2000 2500 3000 3500 3938.111 4000 4500 5000 5500 6000 6500 7000 7500 8000 8500 9000 9500 10000 10500 11000 11500 12000 12500],
  trq=[247.5806 247.5806 247.5806 247.5806 247.5806 247.5806 247.5806 247.5806 247.5806 243.75 216.6667 195 177.2727 162.5 150 139.2857 130 121.875 114.7059 108.3333 102.6316 97.5 92.85714 88.63636 84.78261 81.25 78],
  trq_cp=[243.75 216.6667 195 177.2727 162.5 150 139.2857 130 121.875 114.7059 108.3333 102.6316 97.5 92.85714 88.63636 84.78261 81.25 78],
  J=0.02,
  damp=0.001,
  Tc=0.02,
  map=struct(
    spdindex=[0 1000 2000 3000 3857 4000 5000 6000 7000 8000 9000 10000 11000 12000 12584],
    trqindex=[10 25 50 75 100 125 150 175 200 225 235.2016],
    eff=[84 90 90 90 90 90 90 90 90 90 90 90 90 90 90
     84 90 93 95 95 95 96 95 95 95 95 93 93 93 93
     84 90 93 95 95 95 96 95 96 95 95 95 95 93 93
     84 90 93 95 95 95 96 96 96 95 95 93 95 93 93
     84 90 93 95 95 95 96 96 96 95 95 93 93 93 93
     84 88 90 93 93 95 95 96 95 93 93 93 93 93 93
     84 88 90 90 90 93 95 95 93 93 93 93 93 93 93
     84 88 90 90 90 90 93 93 93 93 93 93 93 93 93
     84 84 88 90 90 90 90 93 93 93 93 93 93 93 93
     84 84 88 90 90 90 90 93 93 93 93 93 93 93 93
     84 84 88 90 90 90 90 93 93 93 93 93 93 93 93]),
  m=20,
  Cp=200)

CtrlVcuHevMmmot = struct(
  max_trq=307,
  max_pwr=124,
  spd=[0 500 1000 1500 2000 2500 3000 3500 3857.045 4000 4500 5000 5500 6000 6500 7000 7500 8000 8500 9000 9500 10000 10500 11000 11500 12000 12500],
  trq=[307 307 307 307 307 307 307 307 307 296.0282 263.1362 236.8226 215.2932 197.3521 182.1712 169.159 157.8817 148.0141 139.3074 131.5681 124.6435 118.4113 112.7726 107.6466 102.9663 98.67606 94.72902],
  trq_cp=[296.0282 263.1362 236.8226 215.2932 197.3521 182.1712 169.159 157.8817 148.0141 139.3074 131.5681 124.6435 118.4113 112.7726 107.6466 102.9663 98.67606 94.72902],
  J=0.02,
  damp=0.0001,
  Tc=0.0267,
  map=struct(
    spdindex=[0 1000 2000 3000 3857 4000 5000 6000 7000 8000 9000 10000 11000 12000 12584],
    trqindex=[10 25 50 75 100 125 150 175 200 225 250 275 300 307],
    eff=[84 90 90 90 90 90 90 90 90 90 90 90 90 90 90
     84 90 93 95 95 95 96 95 95 95 95 93 93 93 93
     84 90 93 95 95 95 96 95 96 95 95 95 95 93 93
     84 90 93 95 95 95 96 96 96 95 95 95 95 93 93
     84 90 93 95 95 95 96 96 96 95 95 93 93 93 90
     84 88 90 93 93 95 95 96 95 95 95 93 93 93 90
     84 88 90 90 90 93 95 95 95 93 93 93 93 93 90
     84 88 90 90 90 90 93 93 93 93 93 93 93 93 90
     84 84 88 90 90 90 93 93 93 93 93 93 93 93 90
     84 84 88 90 90 90 90 93 93 93 93 93 93 93 90
     84 84 84 90 90 90 90 93 93 93 93 93 93 93 90
     84 84 84 88 90 90 90 93 93 93 93 93 93 93 90
     84 84 84 88 88 88 90 93 93 93 93 93 93 93 90
     84 84 84 88 88 88 90 93 93 93 93 93 93 93 90]),
  m=30,
  Cp=200)

CtrlVcuHevMmBattChrgPwrMax = -40000
CtrlVcuHevMmBattDischrgPwrMax = 40000
CtrlVcuHevMmChrgLmtBpt = [1 1 1 1 1 1 1 1 0.7 0.35 0]
CtrlVcuHevMmDischrgLmtBpt = [0 0.35 0.7 1 1 1 1 1 1 1 1]
CtrlVcuHevMmEngPwr = [0 1000 7500 15052.63 19736.84 24421.05 29105.26 33789.47 38473.68 43157.89 47842.11 52526.32 57210.53 61894.74 66578.95 71263.16 75947.37 80631.58 85315.79 90000]
CtrlVcuHevMmEngSpd = [0 1000 1200 1448.849 1712.991 1980.336 2249.116 2517.56 2783.899 3046.364 3303.185 3552.592 3792.817 4022.089 4238.64 4440.699 4626.498 4794.266 4942.234 5068.633]
CtrlVcuHevMmEngTrq = [0 9.549297 59.6831 99.21122 110.0257 117.7598 123.5751 128.1661 131.972 135.2851 138.3085 141.1897 144.0408 146.9513 149.9967 153.2446 156.7587 160.6033 164.8457 169.5599]
CtrlVcuHevMmN_idle = 750
CtrlVcuHevMmRegenBrkCutOff = [0 1]
CtrlVcuHevMmRegenBrkSpdBpt = [5 9]
CtrlVcuHevMmSOCmax = 80
CtrlVcuHevMmSOCtarget = 60
CtrlVcuHevMmSocBpt = [0 10 20 30 40 50 60 70 80 90 100]
CtrlVcuHevMmSOCmin = 40
CtrlVcuHevMmCSChrgFctr = 0.8
CtrlVcuHevMmSOCChrgFctr = [7560000 3780000 0]